# Grasshopper definition Aggregation.gh (Grasshopper 1.0.7)
# plug-ins: Kangaroo2 Components

number_slider = Slider(20, range=0..100)
surface = Surface(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)
mesh_surface = MeshSurface(Surface=surface, UCount=number_slider, VCount=number_slider, Overhang=True, Equalize=False)

# ---- group: RH_IN:UNIT
unit_size = Slider(1.8, range=0..8)

# ---- group: RH_IN:INITIAL VOLUME
scale = Slider(0.618, range=0..1)
height = Slider(20, range=0..100)

# ---- group: RH_IN:NO OF PARTS
no_of_parts = Slider(160, range=0..1000)

# ----
mesh = Mesh(mesh_surface)

# ---- group: RH_IN:ITERATIONS
iterations = Slider(246, range=0..1000)

# ---- group: RH_IN:ROTATION ANGLE
rotation = Slider(90, range=0..100)

# ----
front_extrusion = Slider(0.7, range=0..3)
side_top_scaling = Slider(1, range=0..1)
connection_face = Slider(0.45, range=0..5)
Z = Slider(3, range=0..8)
rotation_2 = Slider(0, range=-45..45)
location = Slider(48, range=0..100)
bounding_box = BoundingBox(Content=mesh, Plane=PlaneXY(0, 0, 0))  # -> Box, Box_2
flip_connection = BooleanToggle(False)
deconstruct_brep = DeconstructBrep(Brep=bounding_box.Box)  # -> Faces, Edges, Vertices
subtraction = Subtraction(A=unit_size, B="0.4")
cluster = Cluster(
    data=location,
    A=unit_size,
    A_2=unit_size,
    A_3=unit_size,
    scale_x="1",
    scale_y=graft(["1", side_top_scaling]),
    scale_z="1",
    data_3=front_extrusion,
    data_4=connection_face,
    d1=rotation_2,
    gate=flip_connection)  # -> length_2, breps, vertices, center_v, line_4, result, result_2
list_item = ListItem(List=deconstruct_brep.Faces, Index=Slider(5, range=0..10), Wrap=True)
area = Area(Geometry=list_item)  # -> Area, Centroid
volume = Volume(Geometry=cluster.breps)  # -> Volume, Centroid
sphere = Sphere(Base=volume.Centroid, Radius=unit_size)
scale_2 = Scale(Geometry=list_item, Center=area.Centroid, Factor=scale)  # -> Geometry, Transform
unit_z = UnitZ(Factor=height)
extrude = Extrude(Base=scale_2.Geometry, Direction=unit_z)
pop3d = Populate3D(Region=extrude, Count=no_of_parts, Seed=1)
lng = ListLength(List=pop3d)
dup = DuplicateData(Data=subtraction, Number=lng, Order=True)
tri = Triangulate(Mesh=mesh)  # -> Mesh, Count
Z_2 = UnitZ(Factor=-0.001)
num = Number(dup)
load = Load(Point=pop3d, ForceVector=Z_2)
spheremeshcollide = CSharpScript(
    M=tri.Mesh,
    Pts=pop3d,
    Radii=num,
    Strength=10,
    Reference="C:\Program Files\Rhino 7\Plug-ins\Grasshopper\Components\KangarooSolver.dll")  # -> out, A; inputs M: Mesh, Pts: list of Point3d, Radii: list of Double, Strength: Double
# ---------- spheremeshcollide: C# ----------
    A = new SphereMeshCollide(M, Pts, Radii, Strength);
# ---------- spheremeshcollide: C# additional code ----------
  public class SphereMeshCollide : GoalObject
  {
    Mesh M;
    List<double> Radii;
    double Strength;

    public SphereMeshCollide(Mesh M, List<Point3d> Pts, List<double> Radii, double Strength)
    {
      int ptCount = Pts.Count;
      PPos = Pts.ToArray();
      Move = new Vector3d[ptCount];
      Weighting = new double[ptCount];

      this.M = M;
      this.Radii = Radii;
      this.Strength = Strength;
    }

    public override void Calculate(List<KangarooSolver.Particle> p)
    {
      Point3d[] pts = this.GetCurrentPositions(p);

      for(int i = 0;i < pts.Length;i++)
      {
        Point3d closest = M.ClosestPoint(pts[i]);
        Vector3d v = pts[i] - closest;
        double len = v.Length;
        if(len < Radii[i])
        {
          double diff = Radii[i] - len;
          v.Unitize();
          Move[i] = v * diff;
          Weighting[i] = Strength;
        }
        else
        {
          Move[i] = Vector3d.Zero;
          Weighting[i] = 0;
        }
      }

    }
  }
# ---------- end spheremeshcollide ----------
collider = Collider(Objects=pop3d, Radii=num, Strength=Slider(1, range=0..1))
data = Data(cluster.breps)
deconstruct_brep_2 = DeconstructBrep(Brep=data)  # -> Faces, Edges, Vertices
zombiesolver = ZombieSolver(GoalObjects=[collider, spheremeshcollide.A, load], Threshold=1e-10, Tolerance=0.01, MaxIterations=iterations)  # -> I, V, O
discontinuity = Discontinuity(Curve=deconstruct_brep_2.Faces, Level=1)  # -> Points, Parameters

# ---- group: rotation angles
list_length = ListLength(List=zombiesolver.V)
series = Series(Start=0, Step=rotation, Count=list_length)

# ----
construct_mesh = ConstructMesh(Vertices=discontinuity.Points, Faces={A=0, B=1, C=2, D=3})
xy_plane = XYPlane(Origin=zombiesolver.V)
mesh_join = MeshJoin(Meshes=flatten(construct_mesh))
rotate = Rotate(Geometry=xy_plane, Angle=degrees(series), Plane=xy_plane)  # -> Geometry, Transform

# ---- group: units distribution
orient = Orient(Geometry=mesh_join, Source=volume.Centroid, Target=rotate.Geometry)  # -> Geometry, Transform

# ----
mesh_join_2 = MeshJoin(Meshes=orient.Geometry)
mesh_edges = MeshEdges(Mesh=mesh_join_2)  # -> NakedEdges, InteriorEdges, NonManifoldEdges
mesh_colours = MeshColours(Mesh=flatten(mesh_join_2), Colours=ColourSwatch(SwatchColor=RGB(250, 102, 174)))
mesh_colours_2 = MeshColours(Mesh=mesh, Colours=ColourSwatch(SwatchColor=RGB(120, 120, 120)))

# ---- group: RH_OUT:units
mesh_2 = Mesh(flatten(mesh_colours))

# ---- group: RH_OUT:basesrf
mesh_3 = Mesh(flatten(mesh_colours_2))

# ---- group: RH_OUT:crv
curve = Curve(mesh_edges.InteriorEdges)

# ---- group: RH_OUT:outline
curve_2 = Curve(surface)

# ==== cluster Cluster
A = ClusterInput()
A_2 = ClusterInput()
A_3 = ClusterInput()
data = ClusterInput()
data_2 = Data(data)
d1 = ClusterInput()
gate = ClusterInput()
data_3 = ClusterInput()
data_4 = ClusterInput()
construct_point = ConstructPoint(XCoordinate=data_2, YCoordinate=0, ZCoordinate=0)
multiplication = Multiplication(A=A, B=".5")
multiplication_2 = Multiplication(A=A_2, B=".5")
multiplication_3 = Multiplication(A=A_3, B=".5")
data_5 = Data(data_3)
data_6 = Data(data_4)
center_box = CenterBox(Base=construct_point, X=multiplication, Y=multiplication_2, Z=multiplication_3)
deconstruct_brep = DeconstructBrep(Brep=center_box)  # -> Faces, Edges, Vertices
area = Area(Geometry=deconstruct_brep.Faces)  # -> Area, Centroid
panel = Panel("""1
2
5""")
cull_index = CullIndex(List=deconstruct_brep.Faces, Indices=panel, Wrap=True)
list_item = ListItem(List=deconstruct_brep.Faces, Index=panel, Wrap=True)
point_list = PointList(Points=area.Centroid, Size="1")
is_planar = IsPlanar(Surface=list_item, Interior=True)  # -> Planar, Plane
deconstruct_plane = DeconstructPlane(Plane=is_planar.Plane)  # -> Origin, XAxis, YAxis, ZAxis
curve = Curve(list_item)
amplitude = Amplitude(Vector=deconstruct_plane.ZAxis, Amplitude=data_5)
move = Move(Geometry=curve, Motion=amplitude)  # -> Geometry, Transform
list_item_2 = ListItem(List=move.Geometry, Index=0, Wrap=True)  # -> Item, Item1, Item2
list_item_3 = ListItem(List=is_planar.Plane, Index=0, Wrap=True)  # -> Item, Item1, Item2
negative = Negative(Value=d1)
point = Point(list_item_3.Item)
point_2 = Point(list_item_3.Item1)
data_7 = Data(list_item_2.Item)
merge = Merge(Data1=d1, Data2=negative)
rotate = Rotate(Geometry=[list_item_2.Item, list_item_2.Item1], Angle=degrees(merge), Plane=[point, point_2])  # -> Geometry, Transform
merge_2 = Merge(Data1=rotate.Geometry, Data2=list_item_2.Item2)
planar = Planar(Curve=merge_2)  # -> Planar, Plane, Deviation
negative_2 = Negative(Value=data_6)
scale_x = ClusterInput()
scale_y = ClusterInput()
scale_z = ClusterInput()
offset_curve = OffsetCurve(Curve=merge_2, Plane=planar.Plane, Distance=negative_2, BothSides=False, Kinks=0, CapType=1)
planar_2 = Planar(Curve=offset_curve)  # -> Planar, Plane, Deviation
panel_2 = Panel(".5")
scale_nu = ScaleNU(Geometry=offset_curve, Plane=planar_2.Plane, ScaleX=scale_x, ScaleY=scale_y, ScaleZ=scale_z)  # -> Geometry, Transform
explode = Explode(Curve=scale_nu.Geometry, Recursive=True)  # -> Segments, Vertices
list_item_4 = ListItem(List=cull_index, Index=0, Wrap=True)  # -> Item, Item1
merge_3 = Merge(Data1=graft(curve), Data2=scale_nu.Geometry)
explode_2 = Explode(Curve=list_item_4.Item1, Recursive=True)  # -> Segments, Vertices
loft = Loft(Curves=merge_3, Options={Adjust=False, Closed=False, LoftEnds=0, LoftSimp=0, LoftType=0, Rebuild=10, Refit=0.01})
brep_edges = BrepEdges(Brep=loft)  # -> Naked, Interior, NonManifold
explode_3 = Explode(Curve=list_item_4.Item, Recursive=True)  # -> Segments, Vertices
length = Length(Curve=explode.Segments)  # -> flatten(Length)
polygon_center = PolygonCenter(Polyline=list_item_4.Item1)  # -> flatten(CenterV), CenterE, CenterA
polygon_center_2 = PolygonCenter(Polyline=list_item_4.Item)  # -> flatten(CenterV), CenterE, CenterA
list_item_5 = ListItem(List=explode_2.Segments, Index="1", Wrap=True)
join_curves = JoinCurves(Curves=brep_edges.Naked, Preserve=False)
list_item_6 = ListItem(List=explode_3.Segments, Index="1", Wrap=True)
list_item_7 = ListItem(List=length, Index=0, Wrap=True)
pull_point = PullPoint(Point=polygon_center.CenterV, Geometry=flatten(list_item_5), ClosestOnly=True)  # -> ClosestPoint, Distance
pull_point_2 = PullPoint(Point=polygon_center_2.CenterV, Geometry=flatten(list_item_6), ClosestOnly=True)  # -> ClosestPoint, Distance
list_item_8 = ListItem(List=join_curves, Index=0, Wrap=True)  # -> Item, Item1
length_2 = ClusterOutput(list_item_7)  # Length
boundary_surfaces = BoundarySurfaces(Edges=list_item_8.Item)
line = Line(StartPoint=polygon_center.CenterV, EndPoint=pull_point.ClosestPoint)
line_2 = Line(StartPoint=polygon_center_2.CenterV, EndPoint=pull_point_2.ClosestPoint)
merge_4 = Merge(Data1=flatten(cull_index), Data2=flatten(loft), Data3=flatten(boundary_surfaces))  # -> flatten(Result)
curve_2 = Curve(boundary_surfaces)
flip_curve = FlipCurve(Curve=curve_2)  # -> Curve, Flag
polygon_center_3 = PolygonCenter(Polyline=boundary_surfaces)  # -> flatten(CenterV), CenterE, CenterA
brep_join = BrepJoin(Breps=merge_4)  # -> Breps, Closed
merge_5 = Merge(Data1=polygon_center.CenterV, Data2=polygon_center_2.CenterV)
merge_6 = Merge(Data1=line, Data2=line_2)
stream_filter = StreamFilter(Gate=gate, Stream0=curve_2, Stream1=flip_curve.Curve)
pull_point_3 = PullPoint(Point=polygon_center_3.CenterV, Geometry=flatten(stream_filter), ClosestOnly=True)  # -> ClosestPoint, Distance
breps = ClusterOutput(brep_join.Breps)
deconstruct_brep_2 = DeconstructBrep(Brep=brep_join.Breps)  # -> Faces, Edges, Vertices
line_3 = Line(StartPoint=polygon_center_3.CenterV, EndPoint=pull_point_3.ClosestPoint)
line_4 = ClusterOutput(line_3)
result = ClusterOutput(merge_5)
result_2 = ClusterOutput(merge_6)
center_v = ClusterOutput(polygon_center_3.CenterV)
vertices = ClusterOutput(deconstruct_brep_2.Vertices)
