# Grasshopper definition LandscapeProject_210311.gh (Grasshopper 1.0.7)
# plug-ins: Kangaroo2 Components, MeshEdit Components

boundary_points = Point([Point(27.15056298, 8.29362798, 0), Point(24.15320821, 25.70320565, 0), Point(17.42059611, 34.99477745, 0), Point(11.76189168, 41.71942812, 0), Point(19.84295872, 66.14863105, 0), Point(35.61097705, 69.35910925, 0), Point(50.13301129, 29.68458258, 0), Point(40.87795605, 15.79861121, 0)])

# ---- group: RH_IN:Trees Location
number_slider = Slider(15, range=1..15)

# ---- group: RH_IN:Trees No
number_slider_2 = Slider(200, range=0..200)

# ---- group: RH_IN:Iterations
number_slider_3 = Slider(40, range=1..100)

# ---- group: RH_IN:Water
water = Slider(48, range=0..100)

# ---- group: RH_IN:Seating
seating = Slider(15, range=0..100)

# ---- group: RH_IN:Green01
green01 = Slider(15, range=0..100)

# ---- group: RH_IN:Green03
geen03 = Slider(37, range=0..100)

# ---- group: RH_IN:Green02
green02 = Slider(29, range=0..100)

# ---- group: RH_IN:Trees Scale
trees_scale = Slider(0.66, range=0..5)

# ---- group: RH_IN:Fillet
fillet_radius = Slider(5, range=0..10)

# ---- group: RH_IN:Fire place
fireplace = Slider(7, range=0..100)

# ---- group: RH_IN:Color Manipulation
boolean_toggle = BooleanToggle(False)

# ---- group: RH_IN:Hue
number_slider_4 = Slider(0, range=0..1)

# ---- group: RH_IN:Show Trees
boolean_toggle_2 = BooleanToggle(True)

# ---- group: RH_IN:Show Annotations
boolean_toggle_3 = BooleanToggle(True)

# ---- group: RH_IN:points
boundary_points_2 = Point([Point(40.35920467, 21.39821951, 0), Point(28.95254173, 59.86734172, 0), Point(13.18452341, 58.38313347, 0), Point(0.1003931708, 44.61319507, 0), Point(14.2279112, 24.85959584, 0), Point(13.78958368, 8.593733774, 0), Point(20.49212767, 0.5281303988, 0), Point(34.21952073, 5.301249224, 0)])  # disabled

# ----
points = GetPoint(boundary_points, AtLeast=1, AtMost=2147483647, Realtime=True)
pline = PolyLine(Vertices=points, Closed=True)
area = Area(Geometry=pline)  # -> Area, Centroid
planar = Planar(Curve=pline)  # -> Planar, Plane, Deviation
neg = Negative(Value=Slider(1.822, range=0..2))
panel = Panel(area.Area)
offset = OffsetCurve(Curve=pline, Distance=neg, Plane=planar.Plane, Corners=1)

# ----
# REMESHING
panel_2 = Panel("3")
custom_mesh_settings = SettingsCustom(
    StitchSeams=True,
    SimplePlanes=False,
    Refine=True,
    MinCount=16,
    MaxCount=400,
    AspectRatio=20,
    MaxDistance=0,
    MaxAngle=20,
    MinEdge=panel_2,
    MaxEdge=panel_2)
boundary = BoundarySurfaces(Edges=offset)
mesh = MeshBrep(Brep=boundary, Settings=custom_mesh_settings)

# ---- group: Boundary
# INITIAL POINTS AND RADIUS
bbox = BoundingBox(Content=offset, Plane=PlaneXY(0, 0, 0))  # -> Box, Box_2
debrep = DeconstructBrep(Brep=bbox.Box)  # -> Faces, Edges, Vertices
item = ListItem(List=debrep.Faces, Index=0, Wrap=True)
crv = Curve(item)

# ----
division = Division(A=water, B="100")
division_2 = Division(A=seating, B="100")
division_3 = Division(A=fireplace, B="100")
division_4 = Division(A=green01, B="100")
division_5 = Division(A=green02, B="100")
division_6 = Division(A=geen03, B="100")

# ---- group: Area Percentages
merge = Merge(Data1=division, Data2=division_2, Data3=division_3, Data4=division_4, Data5=division_5, Data6=division_6)

# ---- group: Area to Radius
area_2 = Area(Geometry=offset)  # -> Area, Centroid
pi = Pi(Factor=1)
multiplication = Multiplication(A=area_2.Area, B=merge)
y = Expression(a=multiplication, y=pi, Expression="sqrt(a/y)")

# ----
ma = MassAddition(Input=merge)  # -> Result, PartialResults
multiplication_2 = Multiplication(A=ma.Result, B="100")

# ----
# SOLVING CURVE INTERSECTIONS WITH PATH
panel_3 = Panel(multiplication_2)
equals = Equality(FirstNumber=merge, SecondNumber="0")  # -> Equality, Inequality
cull = CullPattern(List=y, CullPattern=equals.Inequality)
lng = ListLength(List=cull)
pop2d = Populate2D(Region=crv, Count=lng, Seed=number_slider_3)
radius = Data(cull)
points_2 = Data(pop2d)

# ----
# KANGAROO VARIABLES
spherecurvecollide = CSharpScript(
    C=offset,
    Pts=points_2,
    Radii=radius,
    Strength=1,
    Reference="C:\Program Files\Rhino 7\Plug-ins\Grasshopper\Components\KangarooSolver.dll")  # -> out, flatten(A); inputs C: Curve, Pts: list of Point3d, Radii: list of Double, Strength: Double
# ---------- spherecurvecollide: C# usings ----------
using System.IO;
using System.Linq;
using System.Data;
using System.Drawing;
using System.Reflection;
using System.Windows.Forms;
using System.Xml;
using System.Xml.Linq;
using System.Runtime.InteropServices;

using Rhino.DocObjects;
using Rhino.Collections;
using GH_IO;
using GH_IO.Serialization;
using KPlankton;
using KangarooSolver;
using KangarooSolver.Goals;
# ---------- spherecurvecollide: C# ----------
    A = new SphereCurveCollide(C, Pts, Radii, Strength);
# ---------- spherecurvecollide: C# additional code ----------
  public class SphereCurveCollide : GoalObject
  {
    Curve C;
    double strength;
    double[] radii;

    public SphereCurveCollide(Curve Crv, List<Point3d> Pts, List<double> Radii, double k)
    {
      C = Crv;
      int L = Pts.Count;
      PPos = Pts.ToArray();
      Move = new Vector3d[L];
      Weighting = new double[L];
      radii = Radii.ToArray();
      strength = k;
    }

    public override void Calculate(List<KangarooSolver.Particle> p)
    {
      for (int i = 0; i < PIndex.Length; i++)
      {
        Point3d Pt = p[PIndex[i]].Position;

        var containment0 = C.Contains(Pt, Plane.WorldXY, 0);
        var containment1 = C.Contains(Pt, Plane.WorldXY, radii[i]);

        if (containment0 == PointContainment.Outside)
        {
          double t = new double();
          C.ClosestPoint(Pt, out t);
          Move[i] = C.PointAt(t) - Pt;
          Weighting[i] = strength;
        }
        else if (containment1 != PointContainment.Inside)
        {
          double t = new double();
          C.ClosestPoint(Pt, out t, radii[i]);
          Point3d Closest = C.PointAt(t);
          Vector3d Push = Pt - Closest;
          Push.Unitize();
          Push *= radii[i];
          Point3d Target = Closest + Push;
          Move[i] = Target - Pt;
          Weighting[i] = strength;
        }
        else { Move[i] = Vector3d.Zero; Weighting[i] = 0; }
      }

    }
  }
# ---------- end spherecurvecollide ----------
collider = Collider(Objects=points_2, Radii=radius, Strength=10)
onmesh = OnMesh(Points=points_2, Mesh=mesh, Strength=1)
onplane = OnPlane(Points=points_2, Plane=PlaneXY(0, 0, 0), Strength=10)
show = Show(G=points_2)
zombiesolver = ZombieSolver(
    GoalObjects=[show, onplane, collider, spherecurvecollide.A, onmesh],
    Threshold=1e-10,
    Tolerance=0.01,
    MaxIterations=Slider(146, range=0..1000))  # -> I, V, O

cir = Circle(Plane=zombiesolver.V, Radius=radius)
boundary_2 = Data(offset)
center_points = Data(zombiesolver.V)

# ----
# CREATING BOUNDARIES
trim = TrimWithRegion(Curve=cir, Region=boundary_2)  # -> Inside, Outside
crv_2 = Curve(trim.Inside)
len = Length(Curve=crv_2)
sort = SortList(Keys=len, ValuesA=crv_2)  # -> Keys, ValuesA
item_2 = ListItem(List=sort.ValuesA, Index="-1", Wrap=True)  # -> flatten(Item)
reb = RebuildCurve(Curve=item_2, Degree="1", Count=Slider(4, range=3..12), Tangents=False)

number_slider_5 = Slider(14, range=0..20)

# ----
# SOLVING CURVE INTERSECTIONS
ccx = CurveCurve(CurveA=boundary_2, CurveB=graft(item_2), UseTasks=False)  # -> Points, simplify(ParamsA), ParamsB
extend_curve = ExtendCurve(Curve=reb, Type=0, Start=number_slider_5, End=number_slider_5)
shatter = Shatter(Curve=boundary_2, Parameters=ccx.ParamsA)
len_2 = Length(Curve=shatter)
sort_2 = SortList(Keys=len_2, ValuesA=shatter)  # -> Keys, ValuesA
item_3 = ListItem(List=sort_2.ValuesA, Index=0, Wrap=True)
merge_2 = Merge(Data1=simplify(graft(item_3)), Data2=simplify(graft(reb)))
join = JoinCurves(Curves=merge_2, Preserve=False)

# ---- group: Outlines
fillet = Fillet(Curve=extend_curve, Radius=fillet_radius)
dash_pattern = DashPattern(Curve=fillet, Pattern=[Slider(0.378, range=0..1), Slider(0.525, range=0..1), Slider(0.204, range=0..1)])  # -> Dashes, Gaps

# ----
custom_preview = CustomPreview(Geometry=dash_pattern.Dashes, Material=ColourSwatch(SwatchColor=RGB(0, 0, 0)))
custom_preview_2 = CustomPreview(Geometry=pline, Material=ColourSwatch(SwatchColor=RGB(0, 0, 0)))
preview = CustomPreview(Material=ColourSwatch(SwatchColor=RGB(255, 0, 208)))
preview_2 = CustomPreview(Geometry=cir, Material=ColourSwatch(SwatchColor=RGB(166, 166, 166)))
preview_3 = CustomPreview(Geometry=pline, Material=ColourSwatch(SwatchColor=RGB(255, 255, 255)))

# ----
# REMOVE DUPLICATE CURVES
divide = DivideCurve(Curve=join, Count=10, Kinks=False)  # -> Points, Tangents, Parameters
incurves = PointInCurves(Point=divide.Points, Curves=join)  # -> Relationship, Index, Point
larger = LargerThan(FirstNumber=incurves.Relationship, SecondNumber="2")  # -> LargerThan, OrEqualTo
ma_2 = MassAddition(Input=larger.OrEqualTo)  # -> Result, PartialResults
smaller = SmallerThan(FirstNumber=ma_2.Result, SecondNumber=Slider(4, range=0..10))  # -> SmallerThan, OrEqualTo
cull_2 = CullPattern(List=join, CullPattern=flatten(smaller.SmallerThan))  # -> flatten(List)

item_4 = ListItem(List=cir, Index=0, Wrap=False)  # -> Item, Item1, Item2, Item3, Item4, Item5

# ----
# SORTING CURVES
data = Data(cull_2)
# SORTING CURVES
pcen = PolygonCenter(Polyline=data)  # -> CenterV, CenterE, CenterA
# QUESTIONS
# - how to send text using rhino.compute
# - transparent mesh colour
# - change font of parameters on web
# - Fix camera reset when change a parameter
incurves_2 = PointInCurves(Point=pcen.CenterV, Curves=item_4.Item)  # -> Relationship, Index, Point
incurves_3 = PointInCurves(Point=pcen.CenterV, Curves=item_4.Item1)  # -> Relationship, Index, Point
incurves_4 = PointInCurves(Point=pcen.CenterV, Curves=item_4.Item2)  # -> Relationship, Index, Point
incurves_5 = PointInCurves(Point=pcen.CenterV, Curves=item_4.Item3)  # -> Relationship, Index, Point
incurves_6 = PointInCurves(Point=pcen.CenterV, Curves=item_4.Item4)  # -> Relationship, Index, Point
incurves_7 = PointInCurves(Point=pcen.CenterV, Curves=item_4.Item5)  # -> Relationship, Index, Point
equals_2 = Equality(FirstNumber=incurves_2.Relationship, SecondNumber="0")  # -> Equality, Inequality
equals_3 = Equality(FirstNumber=incurves_3.Relationship, SecondNumber="0")  # -> Equality, Inequality
equals_4 = Equality(FirstNumber=incurves_4.Relationship, SecondNumber="0")  # -> Equality, Inequality
equals_5 = Equality(FirstNumber=incurves_5.Relationship, SecondNumber="0")  # -> Equality, Inequality
equals_6 = Equality(FirstNumber=incurves_6.Relationship, SecondNumber="0")  # -> Equality, Inequality
equals_7 = Equality(FirstNumber=incurves_7.Relationship, SecondNumber="0")  # -> Equality, Inequality
cull_3 = CullPattern(List=data, CullPattern=equals_2.Inequality)
cull_4 = CullPattern(List=data, CullPattern=equals_3.Inequality)
cull_5 = CullPattern(List=data, CullPattern=equals_4.Inequality)
cull_6 = CullPattern(List=data, CullPattern=equals_5.Inequality)
cull_7 = CullPattern(List=data, CullPattern=equals_6.Inequality)
cull_8 = CullPattern(List=data, CullPattern=equals_7.Inequality)

fireplace_2 = Data(cull_5)
greens = Data([cull_6, cull_7, cull_8])
seating_2 = Data(cull_4)
water_2 = Data(cull_3)
data_2 = Data(fillet_radius)
fillet_2 = Fillet(Curve=water_2, Radius=data_2)
fillet_3 = Fillet(Curve=seating_2, Radius=data_2)
fillet_4 = Fillet(Curve=fireplace_2, Radius=data_2)
fillet_5 = Fillet(Curve=greens, Radius=data_2)
number_slider_6 = Slider(1.346, range=0..3)
mesh_2 = Mesh(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)
mesh_volume = MeshVolume(Mesh=mesh_2)  # -> Volume, Centroid
custom_mesh_settings_2 = SettingsCustom(
    StitchSeams=True,
    SimplePlanes=False,
    Refine=True,
    MinCount=16,
    MaxCount=400,
    AspectRatio=20,
    MaxDistance=0,
    MaxAngle=20,
    MinEdge=number_slider_6,
    MaxEdge=number_slider_6)
project = Project(Geometry=mesh_volume.Centroid, Plane=PlaneXY(0, 0, 0))  # -> Geometry, Transform
# SORTING CURVES
merge_3 = Merge(Data1=fillet_2, Data2=fillet_3, Data3=fillet_4, Data4=fillet_5)
merge_4 = Merge(Data1=pline, Data2=fillet_2, Data3=fillet_3, Data4=fillet_5, Data5=fillet_4)  # -> flatten(Result)
boundary_3 = Data(offset)
boundary_4 = BoundarySurfaces(Edges=boundary_3)
point = Point(project.Geometry)
data_3 = Data(fillet_5)
data_4 = Data(fillet_3)
# SEATINGS
number_slider_7 = Slider(3.678, range=0..4)
# POOL MESH
number_slider_8 = Slider(4, range=0..4)
weld = WeldMesh(Mesh=mesh_2, Angle=3.141592654)
# FIREPLACE
data_5 = Data(fillet_4)
# LAND
mesh_3 = MeshBrep(Brep=boundary_4, Settings=custom_mesh_settings_2)
data_6 = Data(fillet_2)
demesh = DeconstructMesh(Mesh=weld)  # -> Vertices, Faces, Colours, Normals
# GREEN MESH
data_7 = Data(fillet_5)
area_3 = Area(Geometry=[data_7, data_6, data_4, data_5])  # -> Area, Centroid
deconstruct = Deconstruct(Point=demesh.Vertices)  # -> XComponent, YComponent, ZComponent
bounds = Bounds(Numbers=deconstruct.ZComponent)
cluster = Cluster_2(curve=data_6, data=Slider(0, range=0..1), data_2=number_slider_7)  # -> S, A
cluster_2 = Cluster_3(curve=data_4, data=Slider(0, range=0..1), data_2=Slider(2, range=0..4))
cluster_3 = Cluster_4(curve=data_5, data=Slider(0, range=0..1), data_2=Slider(2, range=0..4))
cluster_4 = Cluster(curve=data_7, data=Slider(0, range=0..1), data_2=number_slider_8)
cluster_5 = Cluster_5(mesh=mesh_3, geometry=merge_3)
mesh_4 = Mesh(cluster_5)
stream_gate = StreamGate(Stream=mesh_4, Gate=boolean_toggle_2)  # -> Target0, Target1
deconstruct_mesh = DeconstructMesh(Mesh=stream_gate.Target1)  # -> Vertices, Faces, Colours, Normals
pull_point = PullPoint(Point=deconstruct_mesh.Vertices, Geometry=data_3, ClosestOnly=True)  # -> ClosestPoint, Distance
cluster_6 = Cluster_6(mesh=mesh_3)
# ANNOTATIONS
divide_curve = DivideCurve(Curve=cir, Count=10, Kinks=False)  # -> Points, Tangents, Parameters
list_length = ListLength(List=area_3.Centroid)
data_8 = Data(pline)
sort_list = SortList(Keys=pull_point.Distance, ValuesValuesA=deconstruct_mesh.Vertices)  # -> Keys, ValuesValuesA
number_slider_9 = Slider(0.023, range=0..1)
number_slider_10 = Slider(15.4, range=0..100)
remap_numbers = RemapNumbers(Value=deconstruct.ZComponent, Source=bounds, Target=Domain(0, 1))  # -> Mapped, Clipped
unit_z = UnitZ(Factor=1)
random = Random(Range=Domain(10, 15), Number=list_length, Seed=2)
point_in_curve = PointInCurve(Point=divide_curve.Points, Curve=data_8)  # -> Relationship, Point
series = Series(Start=0, Step=number_slider, Count=number_slider_2)
mesh_5 = Mesh(cluster_6)
gradient = Gradient(
    LowerLimit=0,
    UpperLimit=1,
    Parameter=remap_numbers.Mapped,
    stops=[0: RGB(71, 61, 34), 0.625: RGB(171, 151, 22), 0.836: RGB(59, 102, 9)])
negative = Negative(Value=number_slider_9)
weld_2 = WeldMesh(Mesh=mesh_2, Angle=3.141592654)  # disabled
mblur = BlurMesh(Mesh=cluster_4, Iterations=Slider(1, range=0..5))
mblur_2 = BlurMesh(Mesh=cluster.A, Iterations=Slider(1, range=0..5))
line_sdl = LineSDL(Start=area_3.Centroid, Direction=unit_z, Length=random)
list_item = ListItem(List=sort_list.ValuesValuesA, Index=series, Wrap=True)
mblur_3 = BlurMesh(Mesh=cluster_2, Iterations=Slider(2, range=0..5))
data_9 = Data(flatten(dash_pattern.Dashes))
cull_pattern = CullPattern(List=divide_curve.Points, CullPattern=invert(point_in_curve.Relationship))
mblur_4 = BlurMesh(Mesh=cluster_3, Iterations=Slider(2, range=0..5))
data_10 = Data(y)
mesh_offset_extrude = MeshOffsetExtrude(M=cluster_5, B=False, E=Toggle(True), C0=False, C1=True, D=number_slider_9)  # -> out, A; inputs M: Mesh, V: list of Vector3d, D: list
# ---------- mesh_offset_extrude: VB ----------
    Component.Params.Input(0).Name = "Mesh"
    Component.Params.Input(0).Description = "Open or closed mesh"
    Component.Params.Input(1).Name = "Both Sides"
    Component.Params.Input(1).Description = "If true the mesh is offset in both directions along the vertex normals"
    Component.Params.Input(2).Name = "Edges"
    Component.Params.Input(2).Description = "If true the mesh will contain faces on the edges between the two offset mesh faces"
    Component.Params.Input(3).Name = "Closed Bottom"
    Component.Params.Input(3).Description = "If true the mesh will be closed on the origin face"
    Component.Params.Input(4).Name = "Closed Top"
    Component.Params.Input(4).Description = "If true the mesh will be closed on the offset face"
    Component.Params.Input(5).Name = "Vector [Vertex]"
    Component.Params.Input(5).Description = "An optional vector that sets the direction of extrusion, if empty, the new mesh will be offset along the vertex normals"
    Component.Params.Input(6).Name = "Distance [Vertex, Rh Units]"
    Component.Params.Input(6).Description = "A single number or list of numbers corresponding to each vertex of a mesh which sets the Rhino unit based distance that the new geometry is offset from each mesh face"

    Component.Params.Output(1).Name = "Mesh"
    Component.Params.Output(1).Description = "If successful, a valid mesh"

    If m IsNot Nothing Then

      Dim mf As Rhino.Geometry.Collections.MeshFaceList = Nothing
      Dim mv As Rhino.Geometry.Collections.MeshVertexList = Nothing
      Dim mtv As Rhino.Geometry.Collections.MeshTopologyVertexList = Nothing
      Dim mte As Rhino.Geometry.Collections.MeshTopologyEdgeList = Nothing
      Dim mn As Rhino.Geometry.Collections.MeshVertexNormalList = Nothing
      Dim mc As Rhino.Geometry.Collections.MeshVertexColorList = Nothing

      mf = m.Faces
      mv = m.Vertices
      mtv = m.TopologyVertices
      mte = m.TopologyEdges
      mn = m.Normals
      mc = m.VertexColors

      Dim clrB As Boolean = False
      If mc.count() > 0 Then clrB = True

      Dim i,cv,cf,u(1),hd As Integer
      Dim blnV As Boolean
      Dim vec As vector3d
      Dim ova, ovb As New list(Of point3d)
      Dim vf As New list(Of Vector3f)
      Dim ofc As New list(Of MeshFace)
      If b Then hd = 2 Else hd = 1
      
      cv = mv.count()
      cf = mf.count()

      If (D.count() - 1) < cv Then D = matchDbl(D, cv)

      If v.count() > 0 Then
        blnV = True
        If (V.count() - 1) < cv Then V = matchVec(V, cv)
      End If

      'Define Base Vertices
      For i = 0 To cv - 1 Step 1
        If blnV Then vec = V(i) Else vec = mn(i)
        vec.Unitize()
        vec *= (D(i) / hd)

        ovb.add(New point3d(mv(i)) + vec)
        If Not b Then vec *= 0
        vec.Reverse()
        ova.add(New point3d(mv(i)) + vec)
      Next

      If (c0 Or (((Not c0) And (Not e)) And c1)) Then ofc = mf.ToList()

      If ((e or c0) And c1) Then
        For i = 0 To cf - 1 Step 1
          If mf(i).isquad() Then
            ofc.add(New meshface(mf(i).A + cv, mf(i).B + cv, mf(i).C + cv, mf(i).D + cv))
          Else
            ofc.add(New meshface(mf(i).A + cv, mf(i).B + cv, mf(i).C + cv))
          End If
        Next
      End If

      If e Then
        For i = 0 To mte.count() - 1 Step 1

          u(0) = mtv.MeshVertexIndices(mte.GetTopologyVertices(i).I)(0)
          u(1) = mtv.MeshVertexIndices(mte.GetTopologyVertices(i).J)(0)

          If uBound(mte.GetConnectedFaces(i)) < 1 Then
            ofc.add(New meshface(u(0), u(1), u(1) + cv, u(0) + cv))
          End If
        Next
      End If

      Dim mo As New mesh

      If (c0 Or e) Then
        mo.Vertices.AddVertices(ova.toarray())
        If clrB Then mo.VertexColors.AppendColors(mc.ToArray())
      End If
      If (c1 Or e) Then
        mo.Vertices.AddVertices(ovb.toarray())
        If clrB Then mo.VertexColors.AppendColors(mc.ToArray())
      End If

      mo.Faces.AddFaces(ofc)

      A = mo
    End If
# ---------- mesh_offset_extrude: VB additional code ----------
  Private Function matchDbl(ByVal a As list(Of Double), ByVal t As Integer)
    Dim i,k As Integer
    k = a.count()
    For i = 0 To ((t + 1) - k) - 1 Step 1
      a.add(a.item(k - 1))
    Next
    Return a
  End Function

  Private Function matchVec(ByVal a As list(Of vector3d), ByVal t As Integer)
    Dim i,k As Integer
    k = a.count()
    For i = 0 To ((t + 1) - k) - 1 Step 1
      a.add(a.item(k - 1))
    Next
    Return a
  End Function
# ---------- end mesh_offset_extrude ----------
cluster_7 = Cluster_7(data=gradient, B=number_slider_4)
stream_filter = StreamFilter(Gate=boolean_toggle, Stream0=gradient, Stream1=cluster_7)
pull_point_2 = PullPoint(Point=cull_pattern, Geometry=data_8, ClosestOnly=True)  # -> ClosestPoint, Distance
round = Round(Number=data_10)  # -> Nearest, Floor, Ceiling
number_slider_11 = Slider(0.12, range=0..20)  # disabled

# ---- group: Cheap Occlusion
demesh_2 = DeconstructMesh(Mesh=weld_2)  # -> Vertices, Faces, Colours, Normals; disabled
panel_4 = Panel(".005")  # disabled
amp = Amplitude(Vector=demesh_2.Normals, Amplitude=number_slider_11)  # disabled
addition = Addition(A=demesh_2.Vertices, B=amp)  # disabled
meshray = MeshRay(Mesh=weld_2, Point=addition, Direction=amp)  # -> Point, Hit; disabled
gradient_2 = Gradient(LowerLimit=0, UpperLimit=1, Parameter=meshray.Hit, stops=[0.15: RGB(72, 107, 1), 1: RGB(161, 191, 40)])  # disabled
number_slider_12 = Slider(1, range=0..5)  # disabled
mcol = MeshColours(Mesh=weld_2, Colours=gradient_2)  # disabled
mblur_5 = BlurMesh(Mesh=mcol, Iterations=number_slider_12)  # disabled

# ----
end_points = EndPoints(Curve=line_sdl)  # -> Start, End
unweld_mesh = UnweldMesh(Mesh=mesh_offset_extrude.A, Angle=1.570796327)
mblur_6 = BlurMesh(Mesh=mesh_5, Iterations=Slider(3, range=0..5))
unit_z_2 = UnitZ(Factor=1)
round_2 = Round(Number=area_3.Area)  # -> Nearest, Floor, Ceiling
explode = Explode(Curve=data_9, Recursive=True)  # -> Segments, Vertices; disabled
yz_plane = YZPlane(Origin=end_points.End)
list_length_2 = ListLength(List=list_item)
curve = Curve(data_9)
sort_list_2 = SortList(Keys=pull_point_2.Distance, ValuesValuesA=cull_pattern)  # -> Keys, ValuesValuesA
number_slider_13 = Slider(1.21, range=0..5)
mblur_7 = BlurMesh(Mesh=unweld_mesh, Iterations=Slider(3, range=0..5))
concatenate = Concatenate(A="r =", Fragment_A=round.Nearest, Fragment_B=" m")
move = Move(Geometry=yz_plane, Motion=unit_z_2)  # -> Geometry, Transform
random_2 = Random(Range=Domain(0, 180), Number=list_length_2, Seed=2)
cluster_8 = Cluster_8(curve=curve)
xy_plane = XYPlane(Origin=list_item)
concatenate_2 = Concatenate(FragmentA=round_2.Nearest, FragmentB=" m2")
list_item_2 = ListItem(List=sort_list_2.ValuesValuesA, Index="-1", Wrap=True)
panel_5 = Panel(explode.Segments)
rotate = Rotate(Geometry=move.Geometry, Angle=degrees(Slider(218, range=0..1000)), Plane=end_points.End)  # -> Geometry, Transform
rotate_2 = Rotate(Geometry=xy_plane, Angle=degrees(random_2), Plane=xy_plane)  # -> Geometry, Transform
multiplication_3 = Multiplication(A=Slider(0.3, range=0..2))
multiplication_4 = Multiplication(A=Slider(2.2, range=0..5), B=trees_scale)
bool = Boolean(True)
construct_domain = ConstructDomain(DomainStart=multiplication_3, DomainEnd=multiplication_4)
mcol_2 = MeshColours(Mesh=weld, Colours=stream_filter)
bool_2 = Boolean(True)
mblur_8 = BlurMesh(Mesh=mcol_2, Iterations=Slider(1, range=0..5))
orient = Orient(Geometry=mblur_8, Source=point, Target=rotate_2.Geometry)  # -> Geometry, Transform
random_3 = Random(Range=construct_domain, Number=list_length_2, Seed=2)
c_script = CSharpScript(face="Arial", bold=Toggle(True), size=Slider(0.615, range=0..11), content=concatenate_2, pl=rotate.Geometry)  # -> out, A; inputs face: String, bold: Boolean, italics: Boolean, size: Double, content: String, pl: Plane
# ---------- c_script: C# usings ----------
using System.IO;
using System.Linq;
using System.Data;
using System.Drawing;
using System.Reflection;
using System.Windows.Forms;
using System.Xml;
using System.Xml.Linq;
using System.Runtime.InteropServices;

using Rhino.DocObjects;
using Rhino.Collections;
using GH_IO;
using GH_IO.Serialization;
# ---------- c_script: C# ----------
    if(size == 0)
      size = 1;

    if(!string.IsNullOrEmpty(face) && size > 0 && !string.IsNullOrEmpty(content) &&
      pl.IsValid)
    {
      using (var doc = Rhino.RhinoDoc.CreateHeadless(null))
      {
        var te = doc.Objects.AddText(content, pl, size, face, bold, italics);
        var txt = doc.Objects.Find(te) as Rhino.DocObjects.TextObject;

        if(txt != null)
        {
          var tt = txt.Geometry as Rhino.Geometry.TextEntity;
          A = tt.Explode();
        }
      }
    }
# ---------- end c_script ----------
dash_pattern_2 = DashPattern(Curve=cir, Pattern=[Slider(0.378, range=0..1), Slider(1, range=0..1), Slider(0.914, range=0..1), Slider(4, range=0..10)])  # -> flatten(Dashes), Gaps
c_script_2 = CSharpScript(face="Arial", bold=Toggle(False), size=Slider(0.615, range=0..11), content=graft(concatenate), pl=list_item_2)  # -> out, flatten(A); inputs face: String, bold: Boolean, italics: Boolean, size: Double, content: String, pl: Plane; same code as c_script
dash_pattern_3 = DashPattern(Curve=line_sdl, Pattern=[Slider(0.378, range=0..1), Slider(1, range=0..1), Slider(0.914, range=0..1)])  # -> flatten(Dashes), Gaps
scale = Scale(Geometry=orient.Geometry, Center=rotate_2.Geometry, Factor=random_3)  # -> Geometry, Transform
cluster_9 = Cluster_8(curve=dash_pattern_3.Dashes)
cluster_10 = Cluster_9(curve=flatten(c_script_2.A))
cluster_11 = Cluster_8(curve=dash_pattern_2.Dashes)
cluster_12 = Cluster_9(curve=flatten(c_script.A))
mesh_join = MeshJoin(Meshes=scale.Geometry)  # -> flatten(Mesh)
stream_gate_2 = StreamGate(Stream=cluster_10, Gate=boolean_toggle_3)  # -> Target0, Target1
stream_gate_3 = StreamGate(Stream=cluster_9, Gate=boolean_toggle_3)  # -> Target0, Target1
stream_gate_4 = StreamGate(Stream=cluster_11, Gate=boolean_toggle_3)  # -> Target0, Target1
stream_gate_5 = StreamGate(Stream=cluster_12, Gate=boolean_toggle_3)  # -> Target0, Target1

# ---- group: RH_OUT:Trees
mesh_6 = Mesh(mesh_join)

# ---- group: RH_OUT:seating
mesh_7 = Mesh(mblur_3)

# ---- group: RH_OUT:fireplace
mesh_8 = Mesh(mblur_4)

# ---- group: RH_OUT:water
mesh_9 = Mesh(mblur_2)

# ---- group: RH_OUT:land2
mesh_10 = Mesh(mblur_7)

# ---- group: RH_OUT:land
mesh_11 = Mesh(mblur_6)

# ---- group: RH_OUT:verticallines
curve_2 = Curve(flatten(stream_gate_3.Target1))

# ---- group: RH_OUT:areas
curve_3 = Curve(flatten(stream_gate_5.Target1))

# ---- group: RH_OUT:outlines
curve_4 = Curve(flatten(cluster_8))

# ---- group: RH_OUT:green
mesh_12 = Mesh(flatten(mblur))

# ---- group: RH_OUT:radius
curve_5 = Curve(flatten(stream_gate_2.Target1))

# ---- group: RH_OUT:Circles
curve_6 = Curve(flatten(stream_gate_4.Target1))

# ==== cluster Cluster
curve = ClusterInput()
curve_2 = Curve(curve)
length = Length(Curve=curve_2)
number_slider = Slider(2.883, range=0..5)
multiplication = Multiplication(A=length, B=Slider(0.042, range=0..1))
boundary = BoundarySurfaces(Edges=curve_2)
custom_mesh_settings = SettingsCustom(
    StitchSeams=True,
    SimplePlanes=False,
    Refine=True,
    MinCount=16,
    MaxCount=400,
    AspectRatio=20,
    MaxDistance=0,
    MaxAngle=20,
    MinEdge=multiplication,
    MaxEdge=multiplication)
mesh = MeshBrep(Brep=boundary, Settings=custom_mesh_settings)
deconstruct_mesh = DeconstructMesh(Mesh=mesh)  # -> Vertices, Faces, Colours, Normals
mesh_edges = MeshEdges(Mesh=mesh)  # -> simplify(NakedEdges), InteriorEdges, NonManifoldEdges
join_curves = JoinCurves(Curves=mesh_edges.NakedEdges, Preserve=False)  # -> simplify(Curves)
pull_point = PullPoint(Point=simplify(deconstruct_mesh.Vertices), Geometry=simplify(graft(join_curves)), ClosestOnly=True)  # -> ClosestPoint, Distance
data = ClusterInput()
data_2 = ClusterInput()
data_3 = Data(data)
data_4 = Data(data_2)
construct_domain = ConstructDomain(DomainStart=data_3, DomainEnd=data_4)
bounds = Bounds(Numbers=pull_point.Distance)
remap_numbers = RemapNumbers(Value=pull_point.Distance, Source=bounds, Target=construct_domain)  # -> Mapped, Clipped
graph_mapper = GraphMapper(
    remap_numbers.Mapped,
    x0=0,
    x1=4,
    y0=0,
    y1=4,
    container_name="Gaussian",
    factor=0.3855387568,
    mean=0.8877278566,
    sdev=0.3050336838)
unit_z = UnitZ(Factor=graph_mapper)
gradient = Gradient(
    LowerLimit=0,
    UpperLimit=4,
    Parameter=graph_mapper,
    stops=[0: RGB(212, 195, 163), 0.103: RGB(118, 145, 64), 0.672: RGB(212, 242, 90)])
move = Move(Geometry=deconstruct_mesh.Vertices, Motion=unit_z)  # -> Geometry, Transform
construct_mesh = ConstructMesh(Vertices=move.Geometry, Faces=deconstruct_mesh.Faces, Colours=gradient)
m_catmull_clark = WeightedCatmullClarkSubdivision(M=construct_mesh, L=Slider(1, range=0..10), E=Slider(1, range=0..10), DF=0, TE=1, TV=1)  # -> out, A; inputs M: Mesh, DF: list, TE: list, TV: list
# ---------- m_catmull_clark: VB ----------
    Component.Params.Input(0).Name = "Mesh"
    Component.Params.Input(0).Description = "An open or closed mesh composed of either triangle or quad based faces"
    Component.Params.Input(1).Name = "Loops"
    Component.Params.Input(1).Description = "The number of iterations applied to each face"
    Component.Params.Input(2).Name = "Edge Type"
    Component.Params.Input(2).Description = "0=Fixed, 1=Smooth, 2=Fixed Corners"
    Component.Params.Input(3).Name = "Face Distance [Vertex]"
    Component.Params.Input(3).Description = "An optional list of double values which overides the distance the new faced based vertex will be offset along the face normal (0=Default)"
    Component.Params.Input(4).Name = "Edge Weight [Vertex]"
    Component.Params.Input(4).Description = "An optional list of double values which overides the percent between the existing edge midpoint and the new smoothed vertex (1=Default)"
    Component.Params.Input(5).Name = "Vertex Weight [Vertex]"
    Component.Params.Input(5).Description = "An optional list of double values which overides the percent between the existing vertex and the new smoothed vertex (1=Default)"

    Component.Params.Output(1).Name = "Mesh"
    Component.Params.Output(1).Description = "If successful, a valid mesh"

    If m IsNot Nothing Then
      Dim ma As New mesh
      Dim i,lp As Integer
      Dim txV,txE,txF As New list(Of Double)
      Dim xV(),xE(),xF() As Double
      Dim bn As Boolean
      Dim cb As Boolean

      'input mesh to the looped mesh
      m.weld(math.pi)
      ma = m

      ' match multiplier and color values to vertex count
      xV = TV.toarray()
      xE = TE.toarray()
      xF = DF.toarray()
      For i = 0 To m.Vertices.count() - 1 Step 1
        txV.add(xV(bC(xV, i)))
        txE.add(xE(bC(xE, i)))
        txF.add(xF(bC(xF, i)))
      Next
      xV = txV.toarray()
      xE = txE.toarray()
      xF = txF.toarray()

      bn = m.IsClosed() = False

      For lp = 0 To L - 1 Step 1

        Dim mv As Rhino.Geometry.Collections.MeshVertexList
        Dim mf As Rhino.Geometry.Collections.MeshFaceList
        Dim mfn As Rhino.Geometry.Collections.MeshFaceNormalList
        Dim mc As Rhino.Geometry.Collections.MeshVertexColorList
        Dim mte As Rhino.Geometry.Collections.MeshTopologyEdgeList
        Dim mtv As Rhino.Geometry.Collections.MeshTopologyVertexList
        Dim mnv() As Boolean
        Dim nes As New list(Of Boolean)

        If ma.VertexColors.Count() > 0 Then
          cb = True
        Else
          cb = False
          ma.VertexColors.CreateMonotoneMesh(color.LightBlue)
        End If

        mv = ma.Vertices
        mf = ma.Faces
        mfn = ma.FaceNormals
        mc = ma.VertexColors
        mte = ma.TopologyEdges
        mtv = ma.TopologyVertices

        mnv = ma.GetNakedEdgePointStatus

        Dim vo As New list(Of point3d)
        Dim fo As New list(Of MeshFace)
        Dim j,k,u,v,cf,ce,cv As Integer
        Dim fi() As Integer
        Dim p(4) As point3d
        Dim mvi(3) As Integer
        Dim nrm As vector3d
        Dim av,ae,af As Double
        Dim rv,re,rf As New list(Of Double)
        Dim tc As color
        Dim oc As New list(Of color)

        cv = mv.count()
        ce = mte.count()
        cf = mf.count()

        'Faces
        For i = 0 To cf - 1 Step 1
          fi = mtv.IndicesFromFace(i)
          mvi(0) = mtv.MeshVertexIndices(fi(0))(0)
          mvi(1) = mtv.MeshVertexIndices(fi(1))(0)
          mvi(2) = mtv.MeshVertexIndices(fi(2))(0)
          If mf(i).IsQuad() Then mvi(3) = mtv.MeshVertexIndices(fi(3))(0)

          If mf(i).IsQuad() Then
            fo.add(New meshface(i, cF + mte.GetEdgeIndex(fi(0), fi(1)), cE + cF + mvi(1), cF + mte.GetEdgeIndex(fi(1), fi(2))))
            fo.add(New meshface(cF + mte.GetEdgeIndex(fi(1), fi(2)), cE + cF + mvi(2), cF + mte.GetEdgeIndex(fi(2), fi(3)), i))
            fo.add(New meshface(cE + cF + mvi(3), cF + mte.GetEdgeIndex(fi(3), fi(0)), i, cF + mte.GetEdgeIndex(fi(2), fi(3))))
            fo.add(New meshface(cF + mte.GetEdgeIndex(fi(0), fi(1)), i, cF + mte.GetEdgeIndex(fi(3), fi(0)), cE + cF + mvi(0)))
            av = (xV(mvi(0)) + xV(mvi(1)) + xV(mvi(2)) + xV(mvi(3))) / 4
            ae = (xE(mvi(0)) + xE(mvi(1)) + xE(mvi(2)) + xE(mvi(3))) / 4
            af = (xF(mvi(0)) + xF(mvi(1)) + xF(mvi(2)) + xF(mvi(3))) / 4
            tc = avgC4(mc(mvi(0)), mc(mvi(1)), mc(mvi(2)), mc(mvi(3)))
          Else
            fo.add(New meshface(i, cF + mte.GetEdgeIndex(fi(0), fi(1)), cE + cF + mvi(1), cF + mte.GetEdgeIndex(fi(1), fi(2))))
            fo.add(New meshface(cF + mte.GetEdgeIndex(fi(1), fi(2)), cE + cF + mvi(2), cF + mte.GetEdgeIndex(fi(2), fi(0)), i))
            fo.add(New meshface(cE + cF + mvi(0), cF + mte.GetEdgeIndex(fi(0), fi(1)), i, cF + mte.GetEdgeIndex(fi(2), fi(0))))
            av = (xV(mvi(0)) + xV(mvi(1)) + xV(mvi(2))) / 3
            ae = (xE(mvi(0)) + xE(mvi(1)) + xE(mvi(2))) / 3
            af = (xF(mvi(0)) + xF(mvi(1)) + xF(mvi(2))) / 3
            tc = avgC3(mc(mvi(0)), mc(mvi(1)), mc(mvi(2)))
          End If
          nrm = mfn(i)
          nrm.Unitize()
          vo.add(mf.getfacecenter(i) + nrm * af)
          rv.add(av)
          re.add(ae)
          rf.add(af)
          oc.add(tc)
        Next

        'Edges
        For i = 0 To ce - 1 Step 1

          u = mtv.MeshVertexIndices(mte.GetTopologyVertices(i).I)(0)
          v = mtv.MeshVertexIndices(mte.GetTopologyVertices(i).J)(0)
          p(0) = mv.item(u)
          p(1) = mv.item(v)

          If mte.GetConnectedFaces(i).Count() > 1 Then
            p(2) = mf.GetFaceCenter(mte.GetConnectedFaces(i)(0))
            p(3) = mf.GetFaceCenter(mte.GetConnectedFaces(i)(1))
            p(4) = evalP((p(0) + p(1)) / 2, ( p(2) + p(3)) / 2, (xE(u) / 2 + xE(v) / 2) / 2)
            nes.add(False)
          Else
            p(4) = (p(0) + p(1)) / 2
            nes.add(True)
          End If

          vo.add(p(4))
          rv.add((xV(u) + xV(v)) / 2)
          re.add((xE(u) + xE(v)) / 2)
          rf.add((xF(u) + xF(v)) / 2)
          oc.add(avgC2(mc(u), mc(v)))
        Next

        'Vertices
        For i = 0 To cv - 1 Step 1
          Dim zf,zn As Integer
          Dim cvi As New list(Of Integer)
          Dim q(6) As point3d
          Dim bne As Boolean = False
          q(4) = New point3d(mv(i))

          zf = mv.GetVertexFaces(i).count()
          For j = 0 To zf - 1 Step 1
            q(0) += mF.GetFaceCenter(mV.GetVertexFaces(i)(j))
          Next
          q(0) /= zf

          cvi = mv.GetConnectedVertices(i).ToList()
          cvi.remove(i)
          k = cvi.count()
          zn = 0
          For j = 0 To k - 1 Step 1
            u = mte.GetEdgeIndex(mtv.TopologyVertexIndex(cvi.item((j))), mtv.TopologyVertexIndex(i))
            q(1) = mv.item(mtv.MeshVertexIndices(mte.GetTopologyVertices(u).I)(0))
            q(2) = mv.item(mtv.MeshVertexIndices(mte.GetTopologyVertices(u).J)(0))
            q(3) += (q(1) + q(2)) / 2

            If nes(u) Then
              bne = True
              q(5) += (q(1) + q(2)) / 2
              zn += 1
            End If
          Next
          q(3) /= k

          If bne Then
            If e = 1 Then
              q(6) = (q(4) + q(5) / zn) / 2
            ElseIf e = 2 Then
              If k = 2 Then
                q(6) = q(4)
              Else
                q(6) = evalP(q(4), (q(4) + q(5) / zn) / 2, xV(i))
              End If
            Else
              q(6) = q(4)
            End If
          Else
            q(6) = evalP(q(4), (q(4) * ((zf - 3) / zf)) + (q(3) * (2 / zf)) + (q(0) * (1 / zf)), xV(i))
          End If

          vo.add(q(6))
          rv.add(xV(i))
          re.add(xE(i))
          rf.add(xF(i))
          oc.add(mc(i))

        Next

        Dim mo As New mesh
        mo.Vertices.AddVertices(vo)
        mo.Faces.AddFaces(fo)
        If cb Then mo.VertexColors.AppendColors(oc.toarray())
        mo.FaceNormals.ComputeFaceNormals()
        mo.Normals.ComputeNormals()

        ma = mo
        xV = rv.toarray()
        xE = re.toarray()
        xF = rf.toarray()

        'Loop
      Next
      
      A = ma
    End If
# ---------- m_catmull_clark: VB additional code ----------
  Private Function bC(ByVal arrObj() As Double, ByVal t As Integer)
    Dim intOut As Integer
    If t > uBound(arrObj) Then intOut = uBound(arrObj) Else intOut = t
    Return intOut
  End Function

  Private Function evalP(ByVal op As point3d, ByVal tp As Point3d, ByVal t As Double)
    Return New point3d(op + (tp - op) * t)
  End Function

  Private Function avgC2(ByVal c0 As color, ByVal c1 As color)
    Dim r,g,b As Integer
    r = CInt(((CInt(c0.R) + CInt(c1.R)) / 2))
    g = CInt(((CInt(c0.G) + CInt(c1.G)) / 2))
    b = CInt(((CInt(c0.B) + CInt(c1.B)) / 2))

    If R < 0 Then r = 0 Else If r > 255 Then r = 255
    If G < 0 Then g = 0 Else If r > 255 Then g = 255
    If B < 0 Then b = 0 Else If r > 255 Then b = 255

    Return color.FromArgb(r, g, b)
  End Function

  Private Function avgC3(ByVal c0 As color, ByVal c1 As color, ByVal c2 As color)
    Dim r,g,b As Integer
    r = CInt((CInt(c0.R) + CInt(c1.R) + CInt(c2.R)) / 3)
    g = CInt((CInt(c0.G) + CInt(c1.G) + CInt(c2.G)) / 3)
    b = CInt((CInt(c0.B) + CInt(c1.B) + CInt(c2.B)) / 3)

    If R < 0 Then r = 0 Else If r > 255 Then r = 255
    If G < 0 Then g = 0 Else If r > 255 Then g = 255
    If B < 0 Then b = 0 Else If r > 255 Then b = 255

    Return color.FromArgb(r, g, b)
  End Function

  Private Function avgC4(ByVal c0 As color, ByVal c1 As color, ByVal c2 As color, ByVal c3 As color)
    Dim r,g,b As Integer
    r = CInt((CInt(c0.R) + CInt(c1.R) + CInt(c2.R) + CInt(c3.R)) / 4)
    g = CInt((CInt(c0.G) + CInt(c1.G) + CInt(c2.G) + CInt(c3.G)) / 4)
    b = CInt((CInt(c0.B) + CInt(c1.B) + CInt(c2.B) + CInt(c3.B)) / 4)

    If R < 0 Then r = 0 Else If r > 255 Then r = 255
    If G < 0 Then g = 0 Else If r > 255 Then g = 255
    If B < 0 Then b = 0 Else If r > 255 Then b = 255

    Return color.FromArgb(r, g, b)
  End Function
# ---------- end m_catmull_clark ----------
A = ClusterOutput(m_catmull_clark.A)

# ==== cluster Cluster_2
curve = ClusterInput()
curve_2 = Curve(curve)
length = Length(Curve=curve_2)
multiplication = Multiplication(A=length, B=Slider(0.027, range=0..1))
custom_mesh_settings = SettingsCustom(
    StitchSeams=True,
    SimplePlanes=False,
    Refine=True,
    MinCount=16,
    MaxCount=400,
    AspectRatio=20,
    MaxDistance=0,
    MaxAngle=20,
    MinEdge=multiplication,
    MaxEdge=multiplication)
boundary = BoundarySurfaces(Edges=curve_2)
mesh = MeshBrep(Brep=boundary, Settings=custom_mesh_settings)
deconstruct_mesh = DeconstructMesh(Mesh=mesh)  # -> Vertices, Faces, Colours, Normals
mesh_edges = MeshEdges(Mesh=mesh)  # -> simplify(NakedEdges), InteriorEdges, NonManifoldEdges
join_curves = JoinCurves(Curves=mesh_edges.NakedEdges, Preserve=False)  # -> simplify(Curves)
pull_point = PullPoint(Point=simplify(deconstruct_mesh.Vertices), Geometry=simplify(graft(join_curves)), ClosestOnly=True)  # -> ClosestPoint, Distance
data = ClusterInput()
data_2 = ClusterInput()
data_3 = Data(data)
data_4 = Data(data_2)
construct_domain = ConstructDomain(DomainStart=data_3, DomainEnd=data_4)
bounds = Bounds(Numbers=pull_point.Distance)
remap_numbers = RemapNumbers(Value=pull_point.Distance, Source=bounds, Target=construct_domain)  # -> Mapped, Clipped
graph_mapper = GraphMapper(
    remap_numbers.Mapped,
    x0=0,
    x1=4,
    y0=0,
    y1=4,
    amplitude=0.2572207451,
    container_name="Perlin",
    decay=0,
    frequency=0.05485910177,
    x_offset=0.7618785501,
    y_offset=0.1317103505)
graph_mapper_2 = GraphMapper(
    remap_numbers.Mapped,
    x0=0,
    x1=4,
    y0=0,
    y1=4,
    amplitude=0.3,
    container_name="Perlin",
    decay=0.3,
    frequency=0.091429919,
    x_offset=0.4792850316,
    y_offset=0.3638476729)
unit_z = UnitZ(Factor=graph_mapper)
negative = Negative(Value=unit_z)
gradient = Gradient(LowerLimit=0, UpperLimit=4, Parameter=graph_mapper_2, stops=[0: RGB(116, 181, 214), 0.612: RGB(242, 242, 242)])
move = Move(Geometry=deconstruct_mesh.Vertices, Motion=unit_z)  # -> Geometry, Transform
construct_mesh = ConstructMesh(Vertices=move.Geometry, Faces=deconstruct_mesh.Faces, Colours=gradient)
m_catmull_clark = WeightedCatmullClarkSubdivision(M=construct_mesh, L=Slider(1, range=0..10), E=Slider(1, range=0..10), DF=0, TE=1, TV=1)  # -> out, A; inputs M: Mesh, DF: list, TE: list, TV: list; same code as m_catmull_clark
S = ClusterOutput(boundary)
A = ClusterOutput(m_catmull_clark.A)

# ==== cluster Cluster_3
curve = ClusterInput()
curve_2 = Curve(curve)
length = Length(Curve=curve_2)
multiplication = Multiplication(A=length, B=Slider(0.041, range=0..1))
boundary = BoundarySurfaces(Edges=curve_2)
custom_mesh_settings = SettingsCustom(
    StitchSeams=True,
    SimplePlanes=False,
    Refine=True,
    MinCount=16,
    MaxCount=400,
    AspectRatio=20,
    MaxDistance=0,
    MaxAngle=20,
    MinEdge=multiplication,
    MaxEdge=multiplication)
mesh = MeshBrep(Brep=boundary, Settings=custom_mesh_settings)
deconstruct_mesh = DeconstructMesh(Mesh=mesh)  # -> Vertices, Faces, Colours, Normals
mesh_edges = MeshEdges(Mesh=mesh)  # -> simplify(NakedEdges), InteriorEdges, NonManifoldEdges
join_curves = JoinCurves(Curves=mesh_edges.NakedEdges, Preserve=False)  # -> simplify(Curves)
pull_point = PullPoint(Point=simplify(deconstruct_mesh.Vertices), Geometry=simplify(graft(join_curves)), ClosestOnly=True)  # -> ClosestPoint, Distance
data = ClusterInput()
data_2 = ClusterInput()
data_3 = Data(data)
data_4 = Data(data_2)
construct_domain = ConstructDomain(DomainStart=data_3, DomainEnd=data_4)
bounds = Bounds(Numbers=pull_point.Distance)
remap_numbers = RemapNumbers(Value=pull_point.Distance, Source=bounds, Target=construct_domain)  # -> Mapped, Clipped
graph_mapper = GraphMapper(
    remap_numbers.Mapped,
    x0=0,
    x1=2,
    y0=0,
    y1=2,
    container_name="Gaussian",
    factor=0.2434559464,
    mean=0.534869194,
    sdev=0.07443773746)
graph_mapper_2 = GraphMapper(
    remap_numbers.Mapped,
    x0=0,
    x1=2,
    y0=0,
    y1=2,
    container_name="Bezier",
    cpx=[0, 0.3071732819, 0.9333392382, 1],
    cpy=[0, 0.7812573314, 0.8029876947, 0.009866595268])
graph_mapper_3 = GraphMapper(remap_numbers.Mapped, x0=0, x1=2, y0=0, y1=2, container_name="Sigmoid-Logits", e=0.6421194077, t0=-100, t1=100)
unit_z = UnitZ(Factor=graph_mapper)
gradient = Gradient(LowerLimit=0, UpperLimit=2, Parameter=graph_mapper, stops=[0: RGB(209, 191, 159), 1: RGB(110, 103, 89)])
move = Move(Geometry=deconstruct_mesh.Vertices, Motion=unit_z)  # -> Geometry, Transform
construct_mesh = ConstructMesh(Vertices=move.Geometry, Faces=deconstruct_mesh.Faces, Colours=gradient)
m_catmull_clark = WeightedCatmullClarkSubdivision(M=construct_mesh, L=Slider(1, range=0..10), E=Slider(1, range=0..10), DF=0, TE=1, TV=1)  # -> out, A; inputs M: Mesh, DF: list, TE: list, TV: list; same code as m_catmull_clark
A = ClusterOutput(m_catmull_clark.A)

# ==== cluster Cluster_4
curve = ClusterInput()
curve_2 = Curve(curve)
length = Length(Curve=curve_2)
multiplication = Multiplication(A=length, B=Slider(0.036, range=0..1))
boundary = BoundarySurfaces(Edges=curve_2)
custom_mesh_settings = SettingsCustom(
    StitchSeams=True,
    SimplePlanes=False,
    Refine=True,
    MinCount=16,
    MaxCount=400,
    AspectRatio=20,
    MaxDistance=0,
    MaxAngle=20,
    MinEdge=multiplication,
    MaxEdge=multiplication)
mesh = MeshBrep(Brep=boundary, Settings=custom_mesh_settings)
deconstruct_mesh = DeconstructMesh(Mesh=mesh)  # -> Vertices, Faces, Colours, Normals
mesh_edges = MeshEdges(Mesh=mesh)  # -> simplify(NakedEdges), InteriorEdges, NonManifoldEdges
join_curves = JoinCurves(Curves=mesh_edges.NakedEdges, Preserve=False)  # -> simplify(Curves)
pull_point = PullPoint(Point=simplify(deconstruct_mesh.Vertices), Geometry=simplify(graft(join_curves)), ClosestOnly=True)  # -> ClosestPoint, Distance
data = ClusterInput()
data_2 = ClusterInput()
data_3 = Data(data)
data_4 = Data(data_2)
construct_domain = ConstructDomain(DomainStart=data_3, DomainEnd=data_4)
bounds = Bounds(Numbers=pull_point.Distance)
remap_numbers = RemapNumbers(Value=pull_point.Distance, Source=bounds, Target=construct_domain)  # -> Mapped, Clipped
graph_mapper = GraphMapper(
    remap_numbers.Mapped,
    x0=0,
    x1=2,
    y0=0,
    y1=2,
    amplitude=0.6165744066,
    container_name="Perlin",
    decay=0,
    frequency=0.2024769187,
    x_offset=0.4711381495,
    y_offset=0.2926732302)
unit_z = UnitZ(Factor=graph_mapper)
gradient = Gradient(
    LowerLimit=0,
    UpperLimit=2,
    Parameter=graph_mapper,
    stops=[0: RGB(214, 197, 165), 0.215: RGB(117, 110, 99), 1: RGB(217, 199, 169)])
move = Move(Geometry=deconstruct_mesh.Vertices, Motion=unit_z)  # -> Geometry, Transform
negative = Negative(Value=unit_z)
construct_mesh = ConstructMesh(Vertices=move.Geometry, Faces=deconstruct_mesh.Faces, Colours=gradient)
m_catmull_clark = WeightedCatmullClarkSubdivision(M=construct_mesh, L=Slider(1, range=0..10), E=Slider(1, range=0..10), DF=0, TE=1, TV=1)  # -> out, A; inputs M: Mesh, DF: list, TE: list, TV: list; same code as m_catmull_clark
A = ClusterOutput(m_catmull_clark.A)

# ==== cluster Cluster_5
mesh = ClusterInput()
deconstruct_mesh = DeconstructMesh(Mesh=mesh)  # -> Vertices, Faces, Colours, Normals
geometry = ClusterInput()
pull_point = PullPoint(Point=simplify(deconstruct_mesh.Vertices), Geometry=simplify(flatten(geometry)), ClosestOnly=True)  # -> ClosestPoint, Distance
data = Data(Slider(0.5, range=-2..2))
data_2 = Data(Slider(-0.5, range=-2..2))
construct_domain = ConstructDomain(DomainStart=data, DomainEnd=data_2)
bounds = Bounds(Numbers=pull_point.Distance)
remap_numbers = RemapNumbers(Value=pull_point.Distance, Source=bounds, Target=construct_domain)  # -> Mapped, Clipped
graph_mapper = GraphMapper(
    remap_numbers.Mapped,
    x0=-0.5,
    x1=0.5,
    y0=-0.5,
    y1=0.5,
    container_name="Polyline",
    pt=[Point(0, 0.5656545162, 0), Point(0.198851794, 0.4164277315, 0), Point(0.4221709371, 0.7532321215, 0), Point(0.5097478628, 0.356671989, 0), Point(1, 0.5112781525, 0)])
graph_mapper_2 = GraphMapper(
    remap_numbers.Mapped,
    x0=-0.5,
    x1=0.5,
    y0=-0.5,
    y1=0.5,
    amplitude=0.3,
    container_name="Perlin",
    decay=0.7244101763,
    frequency=0.2401840687,
    x_offset=0.5,
    y_offset=0.5)
unit_z = UnitZ(Factor=graph_mapper)
gradient = Gradient(LowerLimit=-0.5, UpperLimit=0.5, Parameter=graph_mapper_2, stops=[0.0306: RGB(145, 110, 58), 1: RGB(250, 243, 222)])
move = Move(Geometry=deconstruct_mesh.Vertices, Motion=unit_z)  # -> Geometry, Transform
construct_mesh = ConstructMesh(Vertices=move.Geometry, Faces=deconstruct_mesh.Faces, Colours=gradient)
m_catmull_clark = WeightedCatmullClarkSubdivision(M=construct_mesh, L=Slider(1, range=0..10), E=Slider(1, range=0..10), DF=0, TE=1, TV=1)  # -> out, A; inputs M: Mesh, DF: list, TE: list, TV: list; same code as m_catmull_clark
A = ClusterOutput(m_catmull_clark.A)

# ==== cluster Cluster_6
mesh = ClusterInput()
mesh_edges = MeshEdges(Mesh=mesh)  # -> NakedEdges, InteriorEdges, NonManifoldEdges
data = Data(mesh_edges.NakedEdges)
join_curves = JoinCurves(Curves=data, Preserve=False)
length = Length(Curve=join_curves)
negative = Negative(Value=Slider(12, range=0..100))
sort_list = SortList(Keys=length, ValuesValuesA=join_curves)  # -> Keys, ValuesValuesA
unit_z = UnitZ(Factor=negative)
list_item = ListItem(List=sort_list.ValuesValuesA, Index="-1", Wrap=True)
move = Move(Geometry=list_item, Motion=unit_z)  # -> Geometry, Transform
polygon_center = PolygonCenter(Polyline=move.Geometry)  # -> CenterV, CenterE, CenterA
number_slider = Slider(60, range=0..100)
number_slider_2 = Slider(58, range=0..100)
scale = Scale(Geometry=move.Geometry, Center=polygon_center.CenterV, Factor=Slider(0.709, range=0..1))  # -> Geometry, Transform
divide_curve = DivideCurve(Curve=list_item, Count=number_slider, Kinks=False)  # -> Points, Tangents, Parameters
divide_curve_2 = DivideCurve(Curve=scale.Geometry, Count=number_slider, Kinks=False)  # -> Points, Tangents, Parameters
construct_domain = ConstructDomain(DomainStart=Slider(0, range=0..20), DomainEnd=Slider(4.3, range=0..20))
list_length = ListLength(List=divide_curve_2.Points)
vector_2pt = Vector2Pt(PointA=divide_curve_2.Points, PointB=polygon_center.CenterV, Unitize=False)  # -> Vector, Length
random = Random(Range=construct_domain, Number=list_length, Seed=2)
amplitude = Amplitude(Vector=vector_2pt.Vector, Amplitude=random)
move_2 = Move(Geometry=divide_curve_2.Points, Motion=amplitude)  # -> Geometry, Transform
multiplication = Multiplication(A=random, B=Slider(0.084, range=0..1))
amplitude_2 = Amplitude(Vector=vector_2pt.Vector, Amplitude=multiplication)
move_3 = Move(Geometry=divide_curve.Points, Motion=amplitude_2)  # -> Geometry, Transform
polyline = PolyLine(Vertices=move_3.Geometry, Closed=True)
polyline_2 = PolyLine(Vertices=move_2.Geometry, Closed=True)
mesh_loft = MeshLoft(P=[polyline, polyline_2], T=Slider(0, range=0..3), O=False, F=False, C=False)  # -> out, M; inputs P: list of Curve, clr: list
# ---------- mesh_loft: VB ----------
    Component.Params.Input(0).Name = "Curves"
    Component.Params.Input(0).Description = "A list of open or closed curves"
    Component.Params.Input(1).Name = "Face Type"
    Component.Params.Input(1).Description = "0=Quad, 1=Triangulate, 2=Zig Zag, 3=Wave, 4=Diamond, 5=Shortest, 6=Longest"
    Component.Params.Input(2).Name = "Attempt Orientation"
    Component.Params.Input(2).Description = "An optional boolean input which if true will attempt to shift each curves control points to reduce torsion"
    Component.Params.Input(3).Name = "Flip"
    Component.Params.Input(3).Description = "An optional boolean input which if true will reverse the direction of triangulation when possible"
    Component.Params.Input(4).Name = "Closed"
    Component.Params.Input(4).Description = "An optional boolean input which if true will connect the last curve back to the first"
    Component.Params.Input(5).Name = "Color [Vertex]"
    Component.Params.Input(5).Description = "An optional color or list of colors corresponding to each new vertex of the mesh"

    Component.Params.Output(1).Name = "Mesh"
    Component.Params.Output(1).Description = "If successful, a valid mesh"

    If P.count() > 1 Then
      Dim MO As New mesh
      Dim mt As New mesh
      Dim i,j,k,r,s,n,u,v,w,x,y As Integer
      Dim arrFc As New list(Of MeshFace)
      Dim arrClr As New list(Of color)
      Dim blnC As New list(Of Boolean)
      Dim us() As Integer
      Dim cen(2), tpt(1) As point3d
      Dim mv As Rhino.Geometry.Collections.MeshVertexList
      Dim oc As New list(Of color)
      mv = mt.Vertices

      'Optional Colors
      Dim tclr As New datatree(Of color)
      Dim tcx As Integer
      For j = 0 To P.count() - 1 Step 1
        Dim tncr As New nurbscurve(P.item(j).tonurbscurve)
        Dim tpln As New polyline(tncr.Points.ControlPolygon())

        Dim cs As New dictionary(Of Integer,Object)
        Dim blnX As New Boolean
        If ((j > clr.count()) Or (clr.count() = 0)) Then
          cs.add(0, color.White)
          cs.add(1, color.White)
        Else
          cs = clr.item(j)
          If cs.count() > 0 Then blnX = True
        End If

        If blnX Then
          For k = 0 To cs.count() - 2 Step 1
            tclr.add(color.FromArgb(cs.item(k).R, cs.item(k).G, cs.item(k).B), New gh_path(j))
          Next
        End If

        If tpln.count() > cs.count() Then
          tcx = cs.count() - 1
          For k = cs.count() To tpln.count() - 2 Step 1
            tclr.add(color.FromArgb(cs.item(tcx).R, cs.item(tcx).G, cs.item(tcx).B), New gh_path(j))
          Next
        End If
      Next

      'Vertices
      s = 0
      If C Then y = 0 Else y = 1
      If f Then x = 0 Else x = 1
      For i = 0 To P.count() - y Step 1
        If i < P.count() Then
          Dim ncrv As New nurbscurve(P.item(i).tonurbscurve())
          Dim npts As Rhino.Geometry.Collections.NurbsCurvePointList
          npts = ncrv.Points()
          Dim pline As polyline = npts.ControlPolygon
          cen(1) = pline.CenterPoint
          If i = 0 Then cen(2) = cen(1)
          If P.item(i).IsClosed() Then
            pline.RemoveAt(pline.Count() - 1)
            blnC.add(True)
          Else
            blnC.add(False)
          End If
          v = pline.Count() - 1
          If o Then
            If (i > 0) Then
              If (blnC.item(i) And blnC.item(i - 1)) Then pline = radSrtPt(cen(1), tpt(0), tpt(1), cen(0), pline)(0)
            Else
              Dim ncrvA As New nurbscurve(P.item(1).tonurbscurve())
              Dim plineA As polyline = ncrvA.points.ControlPolygon
              If P.item(1).IsClosed() Then plineA.RemoveAt(plineA.Count() - 1)
              If (blnC.item(i) And P.item(1).isclosed()) Then pline = radSrtPt(plineA.CenterPoint, pline.item(0), pline.item(pline.count() - 1), pline.CenterPoint, pline)(0)
            End If
          End If

          tpt(0) = pline.item(0)
          tpt(1) = pline.item(pline.count() - 1)
          cen(0) = cen(1)

          mv.AddVertices(pline.ToArray())
          oc.addrange(tclr.branch(i))
          n = s
          us = Series(pline.count() - 1)
        Else
          If o Then
            Dim ncrvA As New nurbscurve(P.item(0).tonurbscurve())
            Dim plineA As polyline = ncrvA.points.ControlPolygon
            If P.item(0).IsClosed() Then plineA.RemoveAt(plineA.Count() - 1)
            us = radSrtPt(cen(2), tpt(0), tpt(1), cen(0), plineA)(1)
          Else
            us = Series(r)
          End If
          n = -1
          If P.item(0).isclosed() Then blnC.add(True) Else blnC.add(False)
        End If

        Dim tu(),tv() As Integer
        If i > 0 Then
          If i = P.count() Then v = r
          If blnC.item(i) Then tv = appendprepend(v) Else tv = prepend(v)
          If blnC.item(i - 1) Then tu = appendprepend(u) Else tu = prepend(u)
          If ubound(tu) > ubound(tv) Then k = ubound(tu) Else k = ubound(tv)
          Dim blnU, blnV As New Boolean
          For j = 1 To k Step 1

            If ((j < ubound(tv)) And (j < ubound(tu))) Then
              'This is where faces with 4 valid vertices go

              Dim d(1) As Double
              Dim viD(3) As Double

              viD(0) = s - u + tu(j)
              viD(1) = s - u + tu(j + 1)
              viD(2) = n + 1 + us(tv(j + 1))
              viD(3) = n + 1 + us(tv(j))

              d(0) = mv.item(viD(0)).distanceto(mv.item(viD(2)))
              d(1) = mv.item(viD(1)).distanceto(mv.item(viD(3)))

              'set edge pattern
              If t = 1 Then'Triangulate
                w = x
              ElseIf t = 2 Then 'ZigZag
                If ((i + 1 + x) Mod 2) Then w = 1 Else w = 0
              ElseIf t = 3 Then 'Wave
                If ((j + 1 + x) Mod 2) Then w = 1 Else w = 0
              ElseIf t = 4 Then 'Diamond
                If ((i + 1 + x) Mod 2) Then
                  If ((j + 1) Mod 2) Then w = 1 Else w = 0
                Else
                  If ((j + 1) Mod 2) Then w = 0 Else w = 1
                End If
              ElseIf t = 5 Then 'Shortest
                If d(0) > d(1) Then w = 0 Else w = 1
              ElseIf t = 6 Then 'Longest Length
                If d(0) > d(1) Then w = 1 Else w = 0
              Else
                w = 2
              End If


              'Assign Faces
              If w = 0 Then
                arrFc.add(New meshface(viD(0), viD(1), viD(3)))
                arrFc.add(New meshface(viD(1), viD(2), viD(3)))
              ElseIf w = 1 Then
                arrFc.add(New meshface(viD(0), viD(1), viD(2)))
                arrFc.add(New meshface(viD(0), viD(2), viD(3)))
              Else
                arrFc.add(New meshface(viD(0), viD(1), viD(2), viD(3)))
              End If

            ElseIf ((j < ubound(tv))) Then
              arrFc.add(New meshface(s - u + tu(ubound(tu)), n + 1 + us(tv(j + 1)), n + 1 + us(tv(j))))
            ElseIf ((j < ubound(tu)))  Then
              arrFc.add(New meshface(s - u + tu(j), s - u + tu(j + 1), n + 1 + us(tv(ubound(tv)))))
            End If
          Next

        Else
          r = v
        End If
        u = v
        s = mv.count() - 1
      Next

      MO.Vertices.AddVertices(mv)
      If clr.count() > 0 Then MO.VertexColors.AppendColors(oc.toarray())
      MO.Faces.AddFaces(arrFc.toarray())
      MO.Normals.ComputeNormals()
      MO.FaceNormals.ComputeFaceNormals()

      M = MO
    End If
# ---------- mesh_loft: VB additional code ----------
  Private Function appendprepend(ByVal i As Integer)
    Dim srsEnum As IEnumerable(Of Integer) = Enumerable.Range(0, i + 1)
    Dim arrVal As New list(Of Integer)
    arrVal = srsEnum.tolist()
    arrVal.add(0)
    arrVal.insert(0, i)
    Return arrVal.toarray()
  End Function

  Private Function prepend(ByVal i As Integer)
    Dim srsEnum As IEnumerable(Of Integer) = Enumerable.Range(0, i + 1)
    Dim arrVal As New list(Of Integer)
    arrVal = srsEnum.tolist()
    arrVal.insert(0, i)
    Return arrVal.toarray()
  End Function

  Private Function Series(ByVal i As Integer)
    Dim srsEnum As IEnumerable(Of Integer) = Enumerable.Range(0, i + 1)
    Dim arrVal As New list(Of Integer)
    arrVal = srsEnum.tolist()
    Return arrVal.toarray()
  End Function

  Private Function radSrtPt(ByVal cenA As point3d, ByVal ptA As point3d, ByVal ptB As point3d, ByVal cenB As point3d, ByVal ptList As polyline)
    Dim i As Integer
    Dim arrOut() As point3d
    Dim vecA, vecB, vecC As New Vector3d
    vecA = (ptA + ptB) / 2 - cenB
    vecB = cenB - cenA
    vecC = vector3d.CrossProduct(vecB, vecA)

    Dim pln As New plane(cenB, vecB, vecA)
    pln = New plane(cenB, pln.YAxis, pln.ZAxis)
    Dim ptTemp As New list(Of point3d)
    Dim dblAng(),dblAngA() As Double
    Dim intSrt() As Integer

    ReDim dblAng(ptList.count() - 1)
    ReDim dblAngA(ptList.count() - 1)
    ReDim intSrt(ptList.count() - 1)

    For i = 0 To ptList.count() - 1 Step 1
      Dim vec As vector3d
      ptTemp.add(ptList.item(i))
      intSrt(i) = i
      vec = pln.ClosestPoint(ptList.item(i)) - cenA
      dblAng(i) = vector3d.VectorAngle(vec, pln.XAxis, pln)
      dblAngA(i) = dblAng(i)
    Next

    arrOut = ptTemp.toarray()
    array.Sort(dblAng, arrOut)
    array.Sort(dblAngA, intSrt)

    Dim plineO As New Polyline(arrOut)

    Return {plineO,intSrt}
  End Function
# ---------- end mesh_loft ----------
fill_mesh_holes = FillMeshHoles(P=polyline_2)  # -> out, M; inputs P: Curve, clr: list of Color
# ---------- fill_mesh_holes: VB ----------
    Component.Params.Input(0).Name = "Curves"
    Component.Params.Input(0).Description = "A list of open or closed curves"
    Component.Params.Input(1).Name = "Vertex Color "
    Component.Params.Input(1).Description = "A an optional list of colors corresponding to each control point of the input curve, and additional color can be added for the center of the new mesh."

    Component.Params.Output(1).Name = "Mesh"
    Component.Params.Output(1).Description = "If successful, a valid mesh"

    If P IsNot Nothing Then
      Dim ncrv As NurbsCurve
      Dim npts As rhino.Geometry.Collections.NurbsCurvePointList
      Dim pline As polyline

      Dim avgClr,tclr As color
      Dim ov As New list(Of point3d)
      Dim oc As New list(Of Color)
      Dim ofc As New list(Of MeshFace)

      Dim i,j As Integer
      ncrv = P.ToNurbsCurve()
      npts = ncrv.Points
      pline = npts.ControlPolygon

      ov = pline.toarray().ToList()
      If P.IsClosed() Then ov.removeat(ov.count() - 1)
      j = ov.count() - 1
      ov.add(pline.CenterPoint)

      For i = 0 To j Step 1
        If (clr.count()) > 0 Then
          If i > (clr.count() - 1) Then tclr = clr.item(clr.count() - 1) Else tclr = clr.item(i)
          If i = 0 Then avgClr = tclr Else avgClr = colorAverage(avgClr, tclr, 0.5)
          oc.add(tclr)
        End If

        If ((i = j) And (P.IsClosed())) Then
          ofc.add(New meshface(i, 0, j + 1))
        Else
          ofc.add(New meshface(i, i + 1, j + 1))
        End If
      Next

      If (clr.count()) > 0 Then If(j + 1) = (clr.count() - 1) Then oc.add(clr.item(j + 1)) Else oc.add(avgClr)

      Dim msh As New mesh
      msh.Vertices.AddVertices(ov.toarray())
      msh.Faces.AddFaces(ofc.toarray())
      If (clr.count()) > 0 Then msh.VertexColors.AppendColors(oc.toarray())

      M = msh
    End If
# ---------- fill_mesh_holes: VB additional code ----------
  Function colorAverage(ByVal clrA As color, ByVal clrB As color, ByVal t As Double)
    Dim clrOut As color
    Dim R,G,B As Integer

    If CInt(clrA.r * t + clrB.r * (1 - t)) > 255 Then
      R = 255
    ElseIf CInt(clrA.r * t + clrB.r * (1 - t)) < 0 Then
      R = 0
    Else
      R = CInt(clrA.r * t + clrB.r * (1 - t))
    End If

    If CInt(clrA.g * t + clrB.g * (1 - t)) > 255 Then
      G = 255
    ElseIf CInt(clrA.g * t + clrB.g * (1 - t)) < 0 Then
      G = 0
    Else
      G = CInt(clrA.g * t + clrB.g * (1 - t))
    End If

    If CInt(clrA.b * t + clrB.b * (1 - t)) > 255 Then
      B = 255
    ElseIf CInt(clrA.b * t + clrB.b * (1 - t)) < 0 Then
      B = 0
    Else
      B = CInt(clrA.b * t + clrB.b * (1 - t))
    End If

    clrOut = color.fromargb(R, G, B)
    Return clrOut
  End Function
# ---------- end fill_mesh_holes ----------
mesh_join = MeshJoin(Meshes=[fill_mesh_holes.M, mesh_loft.M])
weighted_catmull_clark_subdivision = WeightedCatmullClarkSubdivision(M=mesh_join, L=Slider(2, range=0..10), E=2, DF=0, TE=1, TV=1)  # -> out, A; inputs M: Mesh, DF: list, TE: list, TV: list; same code as m_catmull_clark
deconstruct_mesh = DeconstructMesh(Mesh=weighted_catmull_clark_subdivision.A)  # -> Vertices, Faces, Colours, Normals
deconstruct = Deconstruct(Point=deconstruct_mesh.Vertices)  # -> XComponent, YComponent, ZComponent
data_2 = Data(Slider(0.5, range=-2..2))
data_3 = Data(Slider(-0.5, range=-2..2))
construct_domain_2 = ConstructDomain(DomainStart=data_2, DomainEnd=data_3)
bounds = Bounds(Numbers=deconstruct.ZComponent)
remap_numbers = RemapNumbers(Value=deconstruct.ZComponent, Source=bounds, Target=construct_domain_2)  # -> Mapped, Clipped
graph_mapper = GraphMapper(
    remap_numbers.Mapped,
    x0=-0.5,
    x1=0.5,
    y0=-0.5,
    y1=0.5,
    amplitude=0.3,
    container_name="Perlin",
    decay=0.7244101763,
    frequency=0.2401840687,
    x_offset=0.5,
    y_offset=0.5)
gradient = Gradient(LowerLimit=-0.5, UpperLimit=0.5, Parameter=graph_mapper, stops=[0.0306: RGB(145, 110, 58), 1: RGB(250, 243, 222)])
jitter = Jitter(List=gradient, Jitter=Slider(0.249, range=0..1), Seed=2)  # -> Values, Indices
construct_mesh = ConstructMesh(Vertices=deconstruct_mesh.Vertices, Faces=deconstruct_mesh.Faces, Colours=jitter.Values)
mesh_2 = ClusterOutput(construct_mesh)

# ==== cluster Cluster_7
B = ClusterInput()
data = ClusterInput()
data_2 = Data(data)
text_split = TextSplit(Text=data_2, Separators=",")
list_item = ListItem(List=text_split, Index=0, Wrap=True)  # -> Item, Item1, Item2
multiplication = Multiplication(A=list_item.Item1, B=B)
merge = Merge(Data1=list_item.Item, Data2=multiplication, Data3=list_item.Item2)
text_join = TextJoin(Text=merge, Join=",")  # -> flatten(Result)
jitter = Jitter(List=text_join, Jitter=Slider(0.06, range=0..1), Seed=2)  # -> Values, Indices
data_3 = Data(jitter.Values)
data_4 = ClusterOutput(data_3)

# ==== cluster Cluster_8
curve = ClusterInput()
curve_2 = Curve(curve)
list_length = ListLength(List=curve_2)
repeat_data = RepeatData(Data=ColourSwatch(SwatchColor=RGB(194, 194, 194)), Length=list_length)
c_script = CSharpScript(crv=curve_2, color=repeat_data)  # -> out, A; inputs crv: Curve, color: Color
# ---------- c_script: C# ----------
    var c = color.R + "," + color.G + "," + color.B;
    crv.SetUserString("color", c);
    A = crv;
# ---------- end c_script ----------
A = ClusterOutput(c_script.A)

# ==== cluster Cluster_9
curve = ClusterInput()
curve_2 = Curve(curve)
list_length = ListLength(List=curve_2)
repeat_data = RepeatData(Data=ColourSwatch(SwatchColor=RGB(115, 115, 115)), Length=list_length)
c_script = CSharpScript(crv=curve_2, color=repeat_data)  # -> out, A; inputs crv: Curve, color: Color; same code as c_script
A = ClusterOutput(c_script.A)
